# Grasshopper definition stableDif_test00_230614.gh (Grasshopper 1.0.7)
# plug-ins: Printborg

panel = Panel("weird green cows")
path = FilePath("C:\Users\taole\source\repos\AI_Print\AI_Print\user_sketch\output\")
panel_2 = Panel("sk-KbD1s3SPXGcnNDDKkzdhSLKwPkP0GWQUtkbIsECaBj3Umeht")
panel_3 = Panel("100")

# ---- group: mesh resolution
number_slider = Slider(40, range=0..100)
number_slider_2 = Slider(40, range=0..100)

# ----
rec_objectboundary = Rectangle({Plane=PlaneXY(2.758546524, 2.608586538, 0), Size=Domain2(u=-13.04393851..13.04393851, v=-12.61862209..12.61862209)})  # disabled
models = GetControlnetModels(Send=Toggle(False), APIAddress="http://127.0.0.1:7860")  # -> Models, Debug
modules = GetControlnetModules(Send=Toggle(True), APIAddress="http://127.0.0.1:7860")  # -> Models, Debug
cyclomatron_x = SampleAsyncComponent(Generate=Button(), APIKey=panel_2, Prompt=Slider(34, range=0..100), FileDirectory=path, FileName="test1")  # -> Output, Debug; disabled
t2i = TextToImagePrompt(Generate=Button(), APIKey=panel_2, Prompt="weird green cows", FileDirectory=path)  # -> RawPOSTResponse, Link; disabled
item = ListItem(List=modules.Models, Index=Slider(22, range=0..50), Wrap=True)
panel_4 = Panel(t2i.RawPOSTResponse)
panel_5 = Panel(t2i.Link)
panel_6 = Panel(item)
panel_7 = Panel(models.Models)
path_2 = FilePath("C:\Users\taole\source\repos\Printborg\PrintborgGH\user_sketch\scribbleTest_01.png")

rec = Rectangle(rec_objectboundary)
area = Area(Geometry=rec)  # -> Area, Centroid
pdecon = Deconstruct(Point=area.Centroid)  # -> XComponent, YComponent, ZComponent
item_2 = ListItem(List=pdecon.ZComponent, Index=0, Wrap=True)  # -> Item, Item1
subtraction = Subtraction(A=item_2.Item, B=item_2.Item1)
abs = Absolute(Value=subtraction)
num_totalheight = Number(abs)

# ---- group: create base meshes
num = Number(number_slider_2)
num_2 = Number(number_slider)
mplane = MeshPlane(Boundary=rec_objectboundary, WidthCount=num, HeightCount=num_2)  # -> Mesh, Area
mesh_bottom = Mesh(mplane.Mesh)

# ---- group: drawing_inputShapes
crv = Curve(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)
crv_2 = Curve(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)

# ----
facen = FaceNormals()  # -> Centers, Normals
ao_scripts = CreateAlwaysOnScripts(
    Model="control_v11p_sd15_scribble [d4ba51ff]",
    Module="scribble_hed",
    InputImage="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")
image = ImageSampler(
    facen.Centers,
    FilePath="D:\Repos\Printborg\PrintborgGH\user_sketch\scribbleTest_01.png",
    Filter="Colour",
    Interpolate=False,
    Umax=1,
    Umin=0,
    Vmax=1,
    Vmin=0,
    Wrap=1)

# ---- group: object heights
number_slider_3 = Slider(30, range=0..50)
number_slider_4 = Slider(1, range=0..50)

# ----
path_3 = FilePath("D:\Repos\Printborg\PrintborgGH\user_sketch\output\")
a1111payload = CreateAuto1111Payload(
    Prompt="delicious apple",
    NegativePrompt="bad, worse, low quality, strange, ugly",
    SamplerName="Euler",
    Steps="20",
    Width="128",
    Height="128",
    AlwaysOnScripts=ao_scripts)

# ---- group: create fields
crv_3 = Curve(crv)
crv_4 = Curve(crv_2)
num_isovalue = Number(Slider(-1.133, range=-20..20))
mesh_bottom_2 = Mesh(mesh_bottom)
mfield = MeshField(BaseMesh=mesh_bottom_2, DrawingInput=crv_3, IsoValue=num_isovalue, CurveResolution=1)
mfield_2 = MeshField(BaseMesh=mesh_bottom_2, DrawingInput=crv_4, IsoValue=num_isovalue, CurveResolution=1)
# these two blocks need
# to be replaced with the AI stuff
# - i.e. generating layers from
# input images and extracting
# toolpaths from the layers
data_fieldbottom = Data(mfield)
data_fieldtop = Data(mfield_2)

# ---- group: preview colors - will be interpolated
col = Colour([ColourSwatch(SwatchColor=RGB(166, 171, 19)), ColourSwatch(SwatchColor=RGB(8, 0, 255))])

# ----
a41t2i = A1111TextToImage(Generate=Toggle(True), APIAddress="http://127.0.0.1:7860", Payload=a1111payload, FileDirectory=path_3, FileName="tests")  # -> ImageLink, Debug
panel_8 = Panel(a1111payload)
img = ImportImage()

# ---- group: calculate layer dimensions
num_totalheight_2 = Number(number_slider_3)
num_layerheight = Number(number_slider_4)
division = Division(A=num_totalheight_2, B=num_layerheight)
dom = ConstructDomain(DomainStart=0, DomainEnd=num_totalheight_2)
range = Range(Domain=dom, Steps=division)
num_numlayers = Number(division)
num_layerheights = Number(range)

# ----
img_2 = Image(a41t2i.ImageLink)
panel_9 = Panel(a41t2i.Debug)
c_script = CSharpScript()  # -> out, A
# ---------- c_script: C# ----------
    var date = DateTime.Now.ToString("yyMMdd-hhmmss");

    A = date;
# ---------- end c_script ----------

# ---- group: blend top and bottom fields to get intermediate layers
data_fieldbottom_2 = Data(data_fieldbottom)
data_fieldtop_2 = Data(data_fieldtop)
mesh_bottom_3 = Mesh(mesh_bottom)
num_layersparamt = Number(Slider(12, range=0..20))
range_2 = Range(Domain=Domain(0, 1), Steps=num_layersparamt)
fblendmult = BlendFieldsMultiThreaded(BaseMesh=mesh_bottom_3, Field0=data_fieldbottom_2, Field1=data_fieldtop_2, BlendParameters=range_2)  # -> Debug, BlendFields
data_layerfields = Data(fblendmult.BlendFields)

# ----
image_2 = DisplayImage(Image=img_2, Plane=PlaneXY(0, 0, 0), Scale=1)

# ---- group: topBottomPreview
mesh_top = Mesh(mesh_bottom)
col_2 = Colour(col)
fdisp = FieldDisplay(Mesh=mesh_top, Field=data_fieldbottom, Colors=col_2)
fdisp_2 = FieldDisplay(Mesh=mesh_top, Field=data_fieldtop, Colors=col_2)

# ----
panel_10 = Panel(c_script.A)

# ---- group: create mesh representations of layers
num_layerheights_2 = Number(num_layerheights)
mesh_bottom_4 = Mesh(mesh_bottom)
Z = UnitZ(Factor=num_layerheights_2)
move = Move(Geometry=mesh_bottom_4, Motion=Z)  # -> Geometry, Transform
mesh_layermeshes = Mesh(move.Geometry)

# ----
col_3 = Colour(col)

# ---- group: iso contour value
number_slider_5 = Slider(0.443, range=-20..20)

# ---- group: layer preview as fields
mesh_layermeshes_2 = Mesh(mesh_layermeshes)
data_layerfields_2 = Data(data_layerfields)
col_4 = Colour(col_3)
fdisp_3 = FieldDisplay(Mesh=mesh_layermeshes_2, Field=data_layerfields_2, Colors=col_4)

# ---- group: extract frep object as layers
data_layerfields_3 = Data(data_layerfields)
mesh_layermeshes_3 = Mesh(mesh_layermeshes)
numisocontourvalue = Number(number_slider_5)
isoconmulti = IsoContour(Mesh=graft(mesh_layermeshes_3), Field=graft(data_layerfields_3), Tolerance=1, IsoValue=numisocontourvalue)
crv_toolpaths = Curve(isoconmulti)
